# Grasshopper definition ShadowDome.gh (Grasshopper 1.0.8)
# plug-ins: ShapeDiverForGrasshopper, Kangaroo2 Components

sddp = ShapeDiverDocumentPayload({AbsoluteTolerance=0, AngleTolerance=0, DistanceDisplayPrecision=0, GltfVersion="Gltf2", GrasshopperVersion="1.0.0008", InputGroups="{}", OutputGroups="{}", RelativeTolerance=0, RhinoVersion="8.14.24345.15001", UnitSystem=0, VersionCreated="1.20.0.0", VersionSaved="1.23.0.0"})

radius = GetInteger(Slider(16, range=3..20), AtLeast=1, AtMost=1, Maximum=2147483647, Minimum=-2147483648, TreeAccess=False)

fold_number = GetInteger(Slider(6, range=2..10), AtLeast=1, AtMost=1, Maximum=2147483647, Minimum=-2147483648, TreeAccess=False)

yz = YZPlane(Origin=Point(0, 0, 0))
cir = Circle(Plane=PlaneXY(0, 0, 0), Radius=radius)
resolution = Panel("3")
sph = Sphere(Base=yz, Radius=radius)
multiplication = Multiplication(A=resolution, B=fold_number)
area = Area(Geometry=cir)  # -> Area, Centroid
divide = DivideCurve(Curve=cir, Count=multiplication, Kinks=False)  # -> Points, Tangents, Parameters
divide_2 = DivideDomain²(Domain=sph, UCount=Slider(2, range=0..2), VCount=Slider(1, range=0..2))

height_scale = GetNumber(Slider(1.4, range=1..2), AtLeast=1, AtMost=1, Maximum=1.797693135e+308, Minimum=-1.797693135e+308, TreeAccess=False)

ln = Line(StartPoint=area.Centroid, EndPoint=divide.Points)
subsrf = Isotrim(Surface=sph, Domain=divide_2)
item = ListItem(List=subsrf, Index=0, Wrap=True)
scale_nu = ScaleNU(Geometry=item, Plane=PlaneXY(0, 0, 0), ScaleX=1, ScaleY=1, ScaleZ=height_scale)  # -> Geometry, Transform
project = Project(Curve=ln, Brep=scale_nu.Geometry, Direction=Vector(0, 0, 1))  # -> flatten(Curve)
genes = GenePool(Decimals=1, Maximum=2, Minimum=1, Value=[1, 1.5, 1.5])
partition = PartitionList(List=project, Size=resolution)
scale_nu_2 = ScaleNU(Geometry=partition, Plane=PlaneXY(0, 0, 0), ScaleX=genes, ScaleY=genes, ScaleZ=1)  # -> Geometry, Transform
genes_2 = GenePool(Decimals=2, Maximum=1, Minimum=0.5, Value=[1, 0.8, 0.8])
subcrv = SubCurve(BaseCurve=reparameterize(scale_nu_2.Geometry), Domain=genes_2)  # -> flatten(Curve)

cell_size = GetNumber(Slider(1.9, range=1..2), AtLeast=1, AtMost=1, Maximum=1.797693135e+308, Minimum=-1.797693135e+308, TreeAccess=False)

loft_opt = LoftOptions(Closed=Toggle(True), Adjust=False, Rebuild=0, Refit=0, Type=Slider(2, range=0..5))

pattern = GetInteger(Slider(1, range=0..1), AtLeast=1, AtMost=1, Maximum=2147483647, Minimum=-2147483648, TreeAccess=False)

loft = Loft(Curves=subcrv, Options=loft_opt)
project_2 = Project(Geometry=loft, Plane=PlaneXY(0, 0, 0))  # -> Geometry, Transform
triremesh = TriRemesh(Geometry=loft, Length=cell_size, Iterations=25)  # -> Triangulation, Dual, Creases
filter = StreamFilter(Gate=pattern, Stream0=triremesh.Triangulation, Stream1=triremesh.Dual)
mesh = Mesh(filter)
faceb = FaceBoundaries(Mesh=mesh)
pt = ConstructPoint(XCoordinate=0, YCoordinate=0, ZCoordinate=0)
len = Length(Curve=faceb)
pcen = PolygonCenter(Polyline=faceb)  # -> CenterV, CenterE, CenterA
ma = MassAddition(Input=len)  # -> Result, PartialResults
dist = Distance(PointA=pcen.CenterV, PointB=pt)
bnd = Bounds(Numbers=dist)
dom = ConstructDomain(DomainStart=Slider(0.85, range=0..1), DomainEnd=Slider(0.26, range=0..1))
remap = RemapNumbers(Value=dist, Source=bnd, Target=dom)  # -> Mapped, Clipped
scale = Scale(Geometry=faceb, Center=pcen.CenterV, Factor=remap.Mapped)  # -> Geometry, Transform
rulesrf = RuledSurface(CurveA=faceb, CurveB=scale.Geometry)
project_3 = Project(Geometry=rulesrf, Plane=PlaneXY(0, 0, 0))  # -> Geometry, Transform
Z = UnitZ(Factor="0.5")
area_2 = Area(Geometry=project_3.Geometry)  # -> Area, Centroid
area_3 = Area(Geometry=project_2.Geometry)  # -> Area, Centroid
extr = Extrude(Base=rulesrf, Direction=Z)
ma_2 = MassAddition(Input=area_2.Area)  # -> Result, PartialResults
division = Division(A=ma_2.Result, B=area_3.Area)
mesh_2 = MeshBrep(
    Brep=extr,
    Settings={GridMaxCount=0, GridMinCount=16, JaggedSeams=False, MaxEdgeLength=0, MinEdgeLength=0.0001, MinTolerance=0, Refine=True, RefineAngle=0, RelativeTolerance=0.65, SimplePlanes=True, Tolerance=0})
multiplication_2 = Multiplication(A=ma.Result, B=0.9)
multiplication_3 = Multiplication(A=division, B=1.1, C=100)

panel = Panel(area_3.Area)
dome_area = ContextPrint(DomeArea=area_3.Area)
panel_2 = Panel(multiplication_2)
material_cost = ContextPrint(MaterialCost=multiplication_2)
panel_3 = Panel(multiplication_3)
context_print = ContextPrint(ShadowRatio=multiplication_3)

context_bake = ContextBake(Content=mesh_2)
