# Grasshopper definition ShadowDomeConfigurator.gh (Grasshopper 1.0.8)
# plug-ins: Bifocals, ShapeDiverForGrasshopper

sddp = ShapeDiverDocumentPayload({AbsoluteTolerance=0, AngleTolerance=0, DistanceDisplayPrecision=0, GltfVersion="Gltf2", GrasshopperVersion="1.0.0008", InputGroups="{}", OutputGroups="{}", RelativeTolerance=0, RhinoVersion="8.14.24345.15001", UnitSystem=0, VersionCreated="1.22.0.0", VersionSaved="1.22.0.0"})
radius = GetInteger(Slider(100, range=0..100), AtLeast=1, AtMost=1, Maximum=2147483647, Minimum=-2147483648, TreeAccess=False)
number_of_sides = GetInteger(Slider(5, range=0..10), AtLeast=1, AtMost=1, Maximum=2147483647, Minimum=-2147483648, TreeAccess=False)
pt = ConstructPoint(XCoordinate=0, YCoordinate=0, ZCoordinate=0)
polygon = Polygon(Plane=pt, Radius=radius, Segments=number_of_sides, FilletRadius=0)  # -> Polygon, Length
polygon_curve = Curve(polygon.Polygon)
pcen = PolygonCenter(Polyline=polygon_curve)  # -> CenterV, CenterE, CenterA
explode = Explode(Curve=polygon_curve, Recursive=True)  # -> Segments, Vertices
center_point = Point(pcen.CenterV)
cp = ControlPoints(Curve=polygon_curve)  # -> Points, Weights, Knots
cull_i = CullIndex(List=cp.Points, Indices="-1", Wrap=True)
divide = DivideCurve(Curve=reparameterize(explode.Segments), Count=10, Kinks=False)  # -> Points, Tangents, simplify(Parameters)
ln = Line(StartPoint=cull_i, EndPoint=center_point)
multiplication = Multiplication(A=divide.Parameters, B="180")
divide_2 = DivideCurve(Curve=reparameterize(ln), Count=10, Kinks=False)  # -> Points, Tangents, Parameters
rad = Radians(Degrees=multiplication)
Z = UnitZ(Factor=1)
graph = GraphMapper(
    divide_2.Parameters,
    x0=0,
    x1=1,
    y0=0,
    y1=1,
    container_name="Bezier",
    cpx=[0, 0.07101484388, 0.6449275613, 1],
    cpy=[0, 0.4246376753, 0.981159389, 0.3777970672])
vrot = Rotate(Vector=divide.Tangents, Axis=Z, Angle="Rad(90)")
sin = Sine(Value=rad)
multiplication_2 = Multiplication(A=sin, B=Slider(23, range=0..100))
height = GetInteger(Slider(100, range=0..100), AtLeast=1, AtMost=1, Maximum=2147483647, Minimum=-2147483648, TreeAccess=False)
bnd = Bounds(Numbers=graph)
amp = Amplitude(Vector=vrot, Amplitude=multiplication_2)
Z_2 = UnitZ(Factor=multiplication_2)
addition = Addition(A=amp, B=Z_2)
remap = RemapNumbers(Value=graph, Source=bnd, Target=height)  # -> Mapped, Clipped
move = Move(Geometry=divide.Points, Motion=addition)  # -> simplify(Geometry), Transform
Z_3 = UnitZ(Factor=remap.Mapped)
move_2 = Move(Geometry=divide_2.Points, Motion=Z_3)  # -> simplify(Geometry), Transform
nurbs = NurbsCurve(Vertices=move.Geometry, Degree=3, Periodic=False)  # -> Curve, Length, Domain
item = ListItem(List=reverse(move_2.Geometry), Index=0, Wrap=True)
eval = EvaluateLength(Curve=nurbs.Curve, Length="0.5", Normalized=True)  # -> Point, Tangent, Parameter
ln_2 = Line(StartPoint=eval.Point, EndPoint=item)
divide_3 = DivideCurve(Curve=reparameterize(ln_2), Count=10, Kinks=False)  # -> Points, Tangents, Parameters
graph_2 = GraphMapper(
    divide_3.Parameters,
    x0=0,
    x1=1,
    y0=0,
    y1=1,
    container_name="Bezier",
    cpx=[0, 0.1616228074, 0.5160842538, 1],
    cpy=[0, 0.3424925804, 0.4018550515, 0])
nurbs_2 = NurbsCurve(Vertices=move_2.Geometry, Degree=3, Periodic=False)  # -> Curve, Length, Domain
bnd_2 = Bounds(Numbers=graph_2)
eval_2 = EvaluateLength(Curve=nurbs_2.Curve, Length="0.5", Normalized=True)  # -> Point, Tangent, Parameter
flatten = FlattenTree(Tree=nurbs_2.Curve, Path="{0}")
remap_2 = RemapNumbers(Value=graph_2, Source=bnd_2, Target=Slider(37, range=0..100))  # -> Mapped, Clipped
shift = ShiftList(List=flatten, Shift=1, Wrap=True)
devec = DeconstructVector(Vector=eval_2.Tangent)  # -> XComponent, YComponent, ZComponent
Z_4 = UnitZ(Factor=remap_2.Mapped)
graft = GraftTree(Tree=shift, IncludeEmptyLists=True, IncludeNullItems=True)  # -> simplify(Tree)
vec = VectorXYZ(XComponent=devec.XComponent, YComponent=devec.YComponent, ZComponent=0)  # -> Vector, Length
Z_5 = UnitZ(Factor=1)
move_3 = Move(Geometry=divide_3.Points, Motion=Z_4)  # -> Geometry, Transform
vrot_2 = Rotate(Vector=vec.Vector, Axis=Z_5, Angle="Rad(90)")
nurbs_3 = NurbsCurve(Vertices=move_3.Geometry, Degree=3, Periodic=False)  # -> simplify(Curve), Length, Domain
pl = ConstructPlane(Origin=eval_2.Point, XAxis=eval_2.Tangent, YAxis=vrot_2)
merge = Merge(Data1=nurbs_2.Curve, Data2=nurbs_3.Curve, Data3=graft)
deplane = DeconstructPlane(Plane=pl)  # -> Origin, XAxis, YAxis, ZAxis
loft = Loft(Curves=merge, Options={Adjust=False, Closed=False, LoftEnds=0, LoftSimp=0, LoftType=0, Rebuild=10, Refit=0.01})  # -> flatten(Loft)
grid_density = GetNumber(Slider(4.4, range=0..10), AtLeast=1, AtMost=1, Maximum=1.797693135e+308, Minimum=-1.797693135e+308, TreeAccess=False)
project = Project(Geometry=loft, Plane=PlaneXY(0, 0, 0))  # -> flatten(Geometry), Transform
join = BrepJoin(Breps=loft)  # -> Breps, Closed
contour = Contour(Shape=join.Breps, Point=eval_2.Point, Direction=deplane.ZAxis, Distance=grid_density)  # -> simplify(Contours)
area = Area(Geometry=project.Geometry)  # -> Area, Centroid
group = Group(Objects=contour)
ma = MassAddition(Input=area.Area)  # -> Result, PartialResults
pshift = ShiftPaths(Data=group, Offset=-1)
total_area = Number(ma.Result)
subset = SubList(List=reverse(pshift), Domain=Slider(18, range=0..30), Wrap=True)  # -> simplify(List), Index
context_print = ContextPrint(DomeArea=ma.Result)
neg = Negative(Value=Slider(1, range=0..10))
lng = ListLength(List=subset.List)  # -> expr("x-1", simplify(Length))
panel = Panel(ma.Result)
ungroup = Ungroup(Group=subset.List)
Z_6 = UnitZ(Factor=neg)
range = Range(Domain=Domain(0, 1), Steps=lng)
gradient = Gradient(LowerLimit=0, UpperLimit=1, Parameter=range, stops=[0: RGB(130, 190, 255), 0.494: RGB(76, 82, 168), 1: RGB(219, 168, 0)])
flatten_2 = FlattenTree(Tree=ungroup, Path="{0}")
extr = Extrude(Base=ungroup, Direction=Z_6)
len = Length(Curve=flatten_2)
pshift_2 = ShiftPaths(Data=extr, Offset=-1)
ma_2 = MassAddition(Input=len)  # -> Result, PartialResults
preview = CustomPreview(Geometry=pshift_2, Shader=gradient)
multiplication_3 = Multiplication(A=ma_2.Result, B="0.35")
multiplication_4 = Multiplication(A=ma_2.Result, B="0.2")
division = Division(A=multiplication_3, B=total_area)
context_bake = ContextBake(Content=pshift_2)
multiplication_5 = Multiplication(A=division, B=100)
context_print_2 = ContextPrint(ShadowPercentage=multiplication_5)
context_print_3 = ContextPrint(MaterialCost=multiplication_4)
panel_2 = Panel(multiplication_4)
panel_3 = Panel(multiplication_5)
