# Grasshopper definition hops.gh (Grasshopper 1.0.8)

radius = GetInteger(Slider(100, range=0..100), AtLeast=1, AtMost=1, Maximum=2147483647, Minimum=-2147483648, TreeAccess=False)
number_of_sides = GetInteger(Slider(5, range=0..10), AtLeast=1, AtMost=1, Maximum=2147483647, Minimum=-2147483648, TreeAccess=False)
pt = ConstructPoint(XCoordinate=0, YCoordinate=0, ZCoordinate=0)
polygon = Polygon(Plane=pt, Radius=radius, Segments=number_of_sides, FilletRadius=0)  # -> Polygon, Length
polygon_curve = Curve(polygon.Polygon)
pcen = PolygonCenter(Polyline=polygon_curve)  # -> CenterV, CenterE, CenterA
explode = Explode(Curve=polygon_curve, Recursive=True)  # -> Segments, Vertices
center_point = Point(pcen.CenterV)
cp = ControlPoints(Curve=polygon_curve)  # -> Points, Weights, Knots
cull_i = CullIndex(List=cp.Points, Indices="-1", Wrap=True)
divide = DivideCurve(Curve=reparameterize(explode.Segments), Count=10, Kinks=False)  # -> Points, Tangents, simplify(Parameters)
ln = Line(StartPoint=cull_i, EndPoint=center_point)
multiplication = Multiplication(A=divide.Parameters, B="180")
divide_2 = DivideCurve(Curve=reparameterize(ln), Count=10, Kinks=False)  # -> Points, Tangents, Parameters
rad = Radians(Degrees=multiplication)
Z = UnitZ(Factor=1)
graph = GraphMapper(
    divide_2.Parameters,
    x0=0,
    x1=1,
    y0=0,
    y1=1,
    container_name="Bezier",
    cpx=[0, 0.07101484388, 0.6449275613, 1],
    cpy=[0, 0.4246376753, 0.981159389, 0.3777970672])
vrot = Rotate(Vector=divide.Tangents, Axis=Z, Angle="Rad(90)")
sin = Sine(Value=rad)
multiplication_2 = Multiplication(A=sin, B=Slider(23, range=0..100))
height = GetInteger(Slider(100, range=0..100), AtLeast=1, AtMost=1, Maximum=2147483647, Minimum=-2147483648, TreeAccess=False)
bnd = Bounds(Numbers=graph)
amp = Amplitude(Vector=vrot, Amplitude=multiplication_2)
Z_2 = UnitZ(Factor=multiplication_2)
addition = Addition(A=amp, B=Z_2)
remap = RemapNumbers(Value=graph, Source=bnd, Target=height)  # -> Mapped, Clipped
move = Move(Geometry=divide.Points, Motion=addition)  # -> simplify(Geometry), Transform
Z_3 = UnitZ(Factor=remap.Mapped)
move_2 = Move(Geometry=divide_2.Points, Motion=Z_3)  # -> simplify(Geometry), Transform
nurbs = NurbsCurve(Vertices=move.Geometry, Degree=3, Periodic=False)  # -> Curve, Length, Domain
item = ListItem(List=reverse(move_2.Geometry), Index=0, Wrap=True)
eval = EvaluateLength(Curve=nurbs.Curve, Length="0.5", Normalized=True)  # -> Point, Tangent, Parameter
ln_2 = Line(StartPoint=eval.Point, EndPoint=item)
divide_3 = DivideCurve(Curve=reparameterize(ln_2), Count=10, Kinks=False)  # -> Points, Tangents, Parameters
graph_2 = GraphMapper(
    divide_3.Parameters,
    x0=0,
    x1=1,
    y0=0,
    y1=1,
    container_name="Bezier",
    cpx=[0, 0.1616228074, 0.5160842538, 1],
    cpy=[0, 0.3424925804, 0.4018550515, 0])
nurbs_2 = NurbsCurve(Vertices=move_2.Geometry, Degree=3, Periodic=False)  # -> Curve, Length, Domain
bnd_2 = Bounds(Numbers=graph_2)
flatten = FlattenTree(Tree=nurbs_2.Curve, Path="{0}")
remap_2 = RemapNumbers(Value=graph_2, Source=bnd_2, Target=Slider(37, range=0..100))  # -> Mapped, Clipped
shift = ShiftList(List=flatten, Shift=1, Wrap=True)
Z_4 = UnitZ(Factor=remap_2.Mapped)
graft = GraftTree(Tree=shift, IncludeEmptyLists=True, IncludeNullItems=True)  # -> simplify(Tree)
move_3 = Move(Geometry=divide_3.Points, Motion=Z_4)  # -> Geometry, Transform
nurbs_3 = NurbsCurve(Vertices=move_3.Geometry, Degree=3, Periodic=False)  # -> simplify(Curve), Length, Domain
merge = Merge(Data1=nurbs_2.Curve, Data2=nurbs_3.Curve, Data3=graft)
number_slider = Slider(8, range=0..100)
loft = Loft(Curves=merge, Options={Adjust=False, Closed=False, LoftEnds=0, LoftSimp=0, LoftType=0, Rebuild=10, Refit=0.01})  # -> flatten(Loft)
project = Project(Geometry=loft, Plane=PlaneXY(0, 0, 0))  # -> flatten(Geometry), Transform
mesh_uv = MeshSurface(Surface=loft, UCount=number_slider, VCount=number_slider, Overhang=True, Equalize=False)
medges = MeshEdges(Mesh=mesh_uv)  # -> NakedEdges, InteriorEdges, NonManifoldEdges
area = Area(Geometry=project.Geometry)  # -> Area, Centroid
ma = MassAddition(Input=area.Area)  # -> Result, PartialResults
crv = Curve(flatten([medges.NakedEdges, medges.InteriorEdges, medges.NonManifoldEdges]))
cost = ContextPrint(Text=ma.Result)
len = Length(Curve=crv)
pipe = Pipe(Curve=crv, Radius="0.5", Caps=0)
project_2 = Project(Geometry=pipe, Plane=PlaneXY(0, 0, 0))  # -> flatten(Geometry), Transform
ma_2 = MassAddition(Input=len)  # -> Result, PartialResults
panel = Panel(ma.Result)
multiplication_3 = Multiplication(A=ma_2.Result, B="0.4")
clean = CleanTree(RemoveNulls=True, RemoveInvalid=True, RemoveEmpty=False, Tree=project_2.Geometry)
panel_2 = Panel(multiplication_3)
area_2 = Area(Geometry=clean)  # -> Area, Centroid
context_bake = ContextBake(Content=pipe)
cost_2 = ContextPrint(Text=multiplication_3)
ma_3 = MassAddition(Input=area_2.Area)  # -> Result, PartialResults
division = Division(A=ma_3.Result, B=ma.Result)
multiplication_4 = Multiplication(A="100", B=division)
context_print = ContextPrint(ShadowRatio=multiplication_4)
panel_3 = Panel(multiplication_4)
